# Grasshopper definition demo.gh (Grasshopper 1.0.7)
# plug-ins: ghoh

init = GhohInit(Toggle=Toggle(True))  # -> DeviceHandle, Error
panel = Panel(init.Error)
panel_2 = Panel(init.DeviceHandle)
trigger = Trigger(Interval=100, TimerInterval=100, Target=read)
read = GhogRead(DeviceHandle=init.DeviceHandle)  # -> PositionX, PositionY, PositionZ
panel_3 = Panel(read.PositionY)
panel_4 = Panel(read.PositionZ)
panel_5 = Panel(read.PositionX)
